# Grasshopper definition Utilities_Collection of working c# codes.gh (Grasshopper 1.0.7)

# ----
# A LIST OF C# CODE THAT WORKS
# filter data type of a list
c_script = CSharpScript()  # -> out, A; inputs x: list
# ---------- c_script: C# usings ----------
using System.Linq;
# ---------- c_script: C# ----------
    //List <double> output = new List<double>{};

    A = getRadius(x);

    //A = output;
# ---------- c_script: C# additional code ----------
  public List<double> getRadius(List<object> item)
  {
    return item.OfType<double>().ToList();
  }
# ---------- end c_script ----------

# ----
# Tree branch/data management static function
c_script_2 = CSharpScript()  # -> out, A
# ---------- c_script_2: C# ----------
    //ListOfListsToTree("name of listof list");
# ---------- c_script_2: C# additional code ----------
  static Grasshopper.DataTree<T> ListOfListsToTree<T > (List < List < T >> s){
  Grasshopper.DataTree<T> tree = new DataTree<T>();
  for(int i = 0;i < s.Count; i++){
  tree.AddRange(s[i], new GH_Path(i));
}
      return tree;
    }
# ---------- end c_script_2 ----------

# ----
# Loop/iterate through Data Tree
c_script_3 = CSharpScript()  # -> out, A; inputs x: tree
# ---------- c_script_3: C# ----------
    for(int i = 0; i < x.BranchCount; i++){
      for(int j = 0; j < x.Branch(i).Count; j++){
        
      }
    }
# ---------- end c_script_3 ----------
